# Grasshopper definition chair.gh (Grasshopper 1.0.7)
# plug-ins: Triceratops

mesh = Mesh([<mesh referenced from the Rhino model> x10])
nickname = RelativePath()

# ---- group: Adding UserData
lng = ListLength(List=mesh)
demesh = DeconstructMesh(Mesh=mesh)  # -> Vertices, Faces, Colours, Normals
series = Series(Start=0, Step=1, Count=lng)
trim = TrimTree(Tree=series, Depth=1)
lng_2 = ListLength(List=demesh.Vertices)
area = Area(Geometry=mesh)  # -> Area, Centroid
concat = Concatenate(FragmentA="part_", FragmentB=trim)
trim_2 = TrimTree(Tree=lng_2, Depth=1)
entwine = Entwine(Branch00=concat, Branch01=trim_2, Branch02=area.Area, FlattenInputs=True)
panel = Panel("""name
vertices
area""")
flip = FlipMatrix(Data=entwine)
userdata = UserData(Keys=panel, Values=flip)
trim_3 = TrimTree(Tree=userdata, Depth=1)

# ----
panel_2 = Panel("\materials\leather_red_02_4k_jpg\leather_red_02_rough_4k.jpg")
panel_3 = Panel("\materials\leather_red_02_4k_jpg\leather_red_02_coll1_4k.jpg")
concat_2 = Concatenate(FragmentA=nickname, FragmentB=panel_3)
concat_3 = Concatenate(FragmentA=nickname, FragmentB="\materials\leather_red_02_4k_jpg\leather_red_02_nor_4k.jpg")
concat_4 = Concatenate(FragmentA=nickname, FragmentB=panel_2)
concat_5 = Concatenate(FragmentA=nickname, FragmentB="\materials\plywood_4k_jpg\plywood_diff_4k.jpg")
concat_6 = Concatenate(FragmentA=nickname, FragmentB="\materials\plywood_4k_jpg\plywood_nor_4k.jpg")
texture = Texture(ImagePath=concat_2)
texture_2 = Texture(ImagePath=concat_3)
texture_3 = Texture(ImagePath=concat_4)
texture_4 = Texture(ImagePath=concat_5)
texture_5 = Texture(ImagePath=concat_6)
meshstandardmaps = MeshStandardMaterialMaps(
    Map=texture,
    AlphaTest=0.5,
    BumpScale=1,
    DisplacementScale=1,
    NormalMap=texture_2,
    EnvMapIntensity=1,
    RoughnessMap=texture_3,
    AoMapIntensity=1)
meshstandardmaps_2 = MeshStandardMaterialMaps(Map=texture_4, AlphaTest=0.5, BumpScale=1, DisplacementScale=1, NormalMap=texture_5, EnvMapIntensity=1, AoMapIntensity=1)
mesh_2 = Mesh(<mesh referenced from the Rhino model>)
standardmat = MeshStandardMaterial(
    Color=ColourSwatch(SwatchColor=RGB(97, 97, 97)),
    Opacity=1,
    Roughness=1,
    Metalness=0.5,
    Emissive=RGB(0, 0, 0),
    EmissiveIntensity=1,
    Maps=meshstandardmaps)
standardmat_2 = MeshStandardMaterial(
    Color=RGB(255, 255, 255),
    Opacity=1,
    Roughness=Slider(0.7, range=0..1),
    Metalness=Slider(0.2, range=0..1),
    Emissive=RGB(0, 0, 0),
    EmissiveIntensity=1,
    Maps=meshstandardmaps_2)
brep = Brep(<brep referenced from the Rhino model>)
shadowmat = ShadowMaterial(Color=RGB(0, 0, 0), Opacity=Slider(0.1, range=0..1))
neg = Negative(Value=Slider(31, range=0..100))
neg_2 = Negative(Value=Slider(46, range=0..100))
pt = Point(<point referenced from the Rhino model>)
mesh_3 = Mesh(brep)
mesh_4 = Mesh(Mesh=mesh, Material=standardmat_2, DecimalAccuracy=3, UserData=trim_3)
mesh_5 = Mesh(Mesh=mesh_3, Material=shadowmat, DecimalAccuracy=3)
dirlight = DirectionalLight(
    Position=pt,
    Color=RGB(255, 255, 255),
    Intensity=Slider(0.7, range=0..1),
    CastShadow=Toggle(True),
    ShadowTop=Slider(70, range=0..100),
    ShadowBottom=neg,
    ShadowRight=Slider(36, range=0..100),
    ShadowLeft=neg_2,
    ShadowNear=0,
    ShadowFar=Slider(221, range=0..1000))  # -> Helper, Light
mesh_6 = Mesh(Mesh=mesh_2, Material=standardmat, DecimalAccuracy=3)
hemilight = HempisphereLight(
    Color=ColourSwatch(SwatchColor=RGB(196, 231, 255)),
    GroundColor=ColourSwatch(SwatchColor=RGB(217, 205, 189)),
    Intensity=Slider(2.2, range=0..10))
preview = CustomPreview(
    Geometry=dirlight.Helper,
    Material={diffuse=RGB(221, 160, 221), emission=RGB(66, 48, 66), shine=0.5, specular=RGB(255, 255, 255), transparency=0})
scene = CompileScene(Objects=[mesh_4, dirlight.Light, hemilight, mesh_5, mesh_6])
button = Button()
serialize = SerializeObject(Object3d=scene, Minify=False, Run=button)
nickname_2 = RelativePath()
concat_7 = Concatenate(FragmentA=nickname_2, FragmentB="\www\assets")
writetxt = WriteTextFile(Path=concat_7, FileName="chair.json", Data=serialize, Write=button)
