# Grasshopper definition example_scene.gh (Grasshopper 1.0.7)
# plug-ins: glTFexporter

# ----
# Line Vertex Colors
number_slider = Slider(0.1, range=0..10)
crv = Curve([<curve referenced from the Rhino model> x2])
topoly = CurveToPolyline(Curve=crv, ToleranceDistance=0, ToleranceAngle=number_slider)  # -> graft(Polyline), Segments
bang = ExplodeTree(Data=topoly.Polyline)  # -> Branch0, Branch1
cp = ControlPoints(Curve=bang.Branch1)  # -> Points, Weights, Knots
cp_2 = ControlPoints(Curve=bang.Branch0)  # -> Points, Weights, Knots
pdecon = Deconstruct(Point=cp.Points)  # -> XComponent, YComponent, ZComponent
pdecon_2 = Deconstruct(Point=cp_2.Points)  # -> XComponent, YComponent, ZComponent
trim = TrimTree(Tree=pdecon.YComponent, Depth=1)
trim_2 = TrimTree(Tree=pdecon_2.YComponent, Depth=1)
sort = SortList(Keys=trim)  # -> Keys, ValuesA
sort_2 = SortList(Keys=trim_2)  # -> Keys, ValuesA
item = ListItem(List=reverse(sort.Keys), Index=0, Wrap=True)
item_2 = ListItem(List=reverse(sort_2.Keys), Index=0, Wrap=True)
item_3 = ListItem(List=sort.Keys, Index=0, Wrap=True)
item_4 = ListItem(List=sort_2.Keys, Index=0, Wrap=True)
gradient = Gradient(LowerLimit=item_3, UpperLimit=item, Parameter=trim, stops=[0: RGB(255, 229, 0), 1: RGB(0, 168, 219)])
gradient_2 = Gradient(LowerLimit=item_4, UpperLimit=item_2, Parameter=trim_2, stops=[0: RGB(255, 229, 0), 1: RGB(219, 0, 168)])
merge = Merge(Data1=gradient_2, Data2=gradient)
linevertexcolors = LineVertexColors(Line=topoly.Polyline, Colors=merge, DecimalAccuracy=3)

# ----
# Environment Map
panel = Panel("pisa")
path = FilePath("C:\Users\dee\Desktop\Triceratops\examples\materials\pisa\nx.png")
path_2 = FilePath("C:\Users\dee\Desktop\Triceratops\examples\materials\pisa\py.png")
path_3 = FilePath("C:\Users\dee\Desktop\Triceratops\examples\materials\pisa\ny.png")
path_4 = FilePath("C:\Users\dee\Desktop\Triceratops\examples\materials\pisa\pz.png")
path_5 = FilePath("C:\Users\dee\Desktop\Triceratops\examples\materials\pisa\px.png")
path_6 = FilePath("C:\Users\dee\Desktop\Triceratops\examples\materials\pisa\nz.png")
nickname = CubeTexture_Component(Left=path, Front=path_4, Right=path_5, Rear=path_6, Top=path_2, Bottom=path_3, Name=panel)
data = Data(nickname)

# ----
# GH File Location
nickname_2 = RelativePath()

# ----
# MeshVertexColors
# note: Both meshBasicMaterial and meshStandardMaterial components can be used with MeshVertexColors.
# 
# note: MeshVertexColors component overides any color set by the material component.
mesh = Mesh(<mesh referenced from the Rhino model>)
demesh = DeconstructMesh(Mesh=mesh)  # -> Vertices, Faces, Colours, Normals
pdecon_3 = Deconstruct(Point=demesh.Vertices)  # -> XComponent, YComponent, ZComponent
addition = Addition(A=pdecon_3.XComponent, B=pdecon_3.YComponent)
sort_3 = SortList(Keys=addition)  # -> Keys, ValuesA
item_5 = ListItem(List=reverse(sort_3.Keys), Index=0, Wrap=True)
item_6 = ListItem(List=sort_3.Keys, Index=0, Wrap=True)
gradient_3 = Gradient(
    LowerLimit=item_6,
    UpperLimit=item_5,
    Parameter=addition,
    stops=[0: RGB(255, 61, 61), 0.509: RGB(255, 178, 84), 1: RGB(255, 244, 38)])
# Mesh Vertex Colors
mcol = MeshColours(Mesh=mesh, Colours=gradient_3)
standardmat = MeshStandardMaterial(Color=RGB(255, 255, 255), Opacity=1, Roughness=1, Metalness=0.5, Emissive=RGB(0, 0, 0), EmissiveIntensity=1)
meshvertex = MeshVertexColors(Mesh=mcol, Name="mesh_vertex_colors", Material=standardmat, DecimalAccuracy=3)

# ----
# MeshVertexColors w/Faces Colored
# note: While it looks like this component is coloring the mesh faces directly, its actually unwelding the mesh edges and coloring the vertices surrounding each face.
# note: Both meshBasicMaterial and meshStandardMaterial components can be used with MeshVertexColors.
# 
# note: MeshVertexColors component overides any color set by the material component.
mesh_2 = Mesh(<mesh referenced from the Rhino model>)
facen = FaceNormals(Mesh=mesh_2)  # -> Centers, Normals
pdecon_4 = Deconstruct(Point=facen.Centers)  # -> XComponent, YComponent, ZComponent
addition_2 = Addition(A=pdecon_4.XComponent, B=pdecon_4.YComponent)
sort_4 = SortList(Keys=addition_2)  # -> Keys, ValuesA
item_7 = ListItem(List=reverse(sort_4.Keys), Index=0, Wrap=True)
item_8 = ListItem(List=sort_4.Keys, Index=0, Wrap=True)
gradient_4 = Gradient(
    LowerLimit=item_8,
    UpperLimit=item_7,
    Parameter=addition_2,
    stops=[0: RGB(255, 61, 61), 0.509: RGB(255, 178, 84), 1: RGB(255, 244, 38)])
colorface = MeshColorFaces(Mesh=mesh_2, Color=gradient_4)
standardmat_2 = MeshStandardMaterial(Color=RGB(255, 255, 255), Opacity=1, Roughness=1, Metalness=0.5, Emissive=RGB(0, 0, 0), EmissiveIntensity=1)
meshvertex_2 = MeshVertexColors(Mesh=colorface, Name="mesh_face_colors", Material=standardmat_2, DecimalAccuracy=3)

# ----
# MeshStandardMaterial (emissive)
mesh_3 = Mesh([<mesh referenced from the Rhino model> x25])
cluster = Cluster(G=mesh_3)  # -> R, R_2
gradient_5 = Gradient(LowerLimit=0, UpperLimit=1, Parameter=cluster.R, stops=[0: RGB(255, 255, 255), 1: RGB(255, 85, 0)])
standardmat_3 = MeshStandardMaterial(
    Color=ColourSwatch(SwatchColor=RGB(0, 178, 255)),
    Opacity=1,
    Roughness=1,
    Metalness=0.5,
    Emissive=gradient_5,
    EmissiveIntensity=cluster.R_2)
mesh_4 = Mesh(Mesh=mesh_3, Name="meshStandardMaterial", Material=standardmat_3, DecimalAccuracy=3)

# ----
# Points w/PointsMaterial + Texture
pt = Point([<point referenced from the Rhino model> x200])
pdecon_5 = Deconstruct(Point=pt)  # -> XComponent, YComponent, ZComponent
sort_5 = SortList(Keys=pdecon_5.YComponent)  # -> Keys, ValuesA
item_9 = ListItem(List=reverse(sort_5.Keys), Index=0, Wrap=True)
item_10 = ListItem(List=sort_5.Keys, Index=0, Wrap=True)
gradient_6 = Gradient(LowerLimit=item_10, UpperLimit=item_9, Parameter=pdecon_5.YComponent, stops=[0: RGB(255, 229, 0), 1: RGB(219, 0, 168)])
pointsmat = PointsMaterial(Color=RGB(255, 255, 255), Size=Slider(0.2, range=0..10), SizeAttenuation=True, AlphaTest=0.5)
pointvertexcolors = PointVertexColors(Points=pt, PointsMaterial=pointsmat, Colors=gradient_6, DecimalAccuracy=3)

# ----
# UV Texture
panel_2 = Panel("\Materials\uv_grid_opengl.jpg")
nickname_3 = RelativePath()
concat = Concatenate(FragmentA=nickname_3, FragmentB=panel_2)
texture = Texture(ImagePath=concat)
meshstandardmaps = MeshStandardMaterialMaps(Map=texture, AlphaTest=0.5, BumpScale=1, DisplacementScale=1, EnvMapIntensity=1, AoMapIntensity=1)
# Mesh Textures
mesh_5 = Mesh(<mesh referenced from the Rhino model>)
mesh_6 = Mesh(<mesh referenced from the Rhino model>)
mesh_7 = Mesh(<mesh referenced from the Rhino model>)
standardmat_4 = MeshStandardMaterial(
    Color=RGB(255, 255, 255),
    Opacity=1,
    Roughness=1,
    Metalness=0.5,
    Emissive=RGB(0, 0, 0),
    EmissiveIntensity=1,
    Maps=meshstandardmaps)
merge_2 = Merge(Data1=mesh_5, Data2=mesh_6, Data3=mesh_7)
mesh_8 = Mesh(Mesh=merge_2, Name="normal map", Material=standardmat_4, DecimalAccuracy=3)

# ----
# LineBasicMaterial
number_slider_2 = Slider(0.1, range=0..10)
crv_2 = Curve([<curve referenced from the Rhino model> x2])
topoly_2 = CurveToPolyline(Curve=crv_2, ToleranceDistance=0, ToleranceAngle=number_slider_2)  # -> Polyline, Segments
linebasicmat = LineBasicMaterial(Color=ColourSwatch(SwatchColor=RGB(77, 201, 255)), LineWidth=1)
line = Line(Line=topoly_2.Polyline, LineMaterial=linebasicmat, DecimalAccuracy=3)

# ----
# LineDashedMaterial
number_slider_3 = Slider(0.1, range=0..10)
crv_3 = Curve([<curve referenced from the Rhino model> x2])
topoly_3 = CurveToPolyline(Curve=crv_3, ToleranceDistance=0, ToleranceAngle=number_slider_3)  # -> Polyline, Segments
linedashmat = LineDashedMaterial(
    Color=ColourSwatch(SwatchColor=RGB(77, 201, 255)),
    LineWidth=1,
    DashSize=Slider(0.2, range=0..10),
    GapSize=Slider(0.2, range=0..10))
line_2 = Line(Line=topoly_3.Polyline, LineMaterial=linedashmat, DecimalAccuracy=3)

# ----
# Line
number_slider_4 = Slider(0.1, range=0..10)
crv_4 = Curve([<curve referenced from the Rhino model> x2])
# Line Geometry
topoly_4 = CurveToPolyline(Curve=crv_4, ToleranceDistance=0, ToleranceAngle=number_slider_4)  # -> Polyline, Segments
line_3 = Line(Line=topoly_4.Polyline, DecimalAccuracy=3)

# ----
# Chrome Texture
number_slider_5 = Slider(1.5, range=0..10)
data_2 = Data(data)
meshstandardmaps_2 = MeshStandardMaterialMaps(AlphaTest=0.5, BumpScale=1, DisplacementScale=1, EnvMap=data_2, EnvMapIntensity=number_slider_5, AoMapIntensity=1)
mesh_9 = Mesh(<mesh referenced from the Rhino model>)
mesh_10 = Mesh(<mesh referenced from the Rhino model>)
mesh_11 = Mesh(<mesh referenced from the Rhino model>)
merge_3 = Merge(Data1=mesh_9, Data2=mesh_10, Data3=mesh_11)
standardmat_5 = MeshStandardMaterial(
    Color=RGB(255, 255, 255),
    Opacity=1,
    Roughness=Slider(0, range=0..100),
    Metalness=Slider(1, range=0..1),
    Emissive=RGB(0, 0, 0),
    EmissiveIntensity=1,
    Maps=meshstandardmaps_2)
mesh_12 = Mesh(Mesh=merge_3, Name="chrome", Material=standardmat_5, DecimalAccuracy=3)

# ----
# MeshBasicMaterial (wireframe)
number_slider_6 = Slider(1, range=0..10)
wireframe = Wireframe(WireframeLineJoin="round", WireframeLineWidth=number_slider_6)
mesh_13 = Mesh([<mesh referenced from the Rhino model> x3])
basicmat = MeshBasicMaterial(Color=ColourSwatch(SwatchColor=RGB(255, 132, 87)), Wireframe=wireframe)
mesh_14 = Mesh(Mesh=mesh_13, Name="meshBasicMaterial_wireframe", Material=basicmat, DecimalAccuracy=3)

concat_2 = Concatenate(FragmentA=nickname_2, FragmentB="/materials/factory_brick_1k_jpg/factory_brick_diff_1k.jpg")
concat_3 = Concatenate(FragmentA=nickname_2, FragmentB="/materials/factory_brick_1k_jpg/factory_brick_diff_1k.jpg")
concat_4 = Concatenate(FragmentA=nickname_2, FragmentB="/materials/factory_brick_1k_jpg/factory_brick_diff_1k.jpg")

# ----
# Points w/PointsMaterial + Texture
panel_3 = Panel("\materials\triceratops-logo-medium.png")
nickname_4 = RelativePath()
concat_5 = Concatenate(FragmentA=nickname_4, FragmentB=panel_3)
texture_2 = Texture(ImagePath=concat_5)
pt_2 = Point([<point referenced from the Rhino model> x200])
pointsmat_2 = PointsMaterial(Color=RGB(255, 255, 255), Size=Slider(0.3, range=0..10), SizeAttenuation=True, Map=texture_2, AlphaTest=0.5)
points = Points(Points=pt_2, PointsMaterial=pointsmat_2, DecimalAccuracy=3)

# ----
# MeshStandardMaterial (metallic)
data_3 = Data(data)
mesh_15 = Mesh([<mesh referenced from the Rhino model> x25])
meshstandardmaps_3 = MeshStandardMaterialMaps(
    AlphaTest=0.5,
    BumpScale=1,
    DisplacementScale=1,
    EnvMap=data_3,
    EnvMapIntensity=Slider(1.5, range=0..10),
    AoMapIntensity=1)
cluster_2 = Cluster(G=mesh_15)  # -> R, R_2
standardmat_6 = MeshStandardMaterial(
    Color=ColourSwatch(SwatchColor=RGB(0, 178, 255)),
    Opacity=1,
    Roughness=cluster_2.R,
    Metalness=cluster_2.R_2,
    Emissive=RGB(0, 0, 0),
    EmissiveIntensity=1,
    Maps=meshstandardmaps_3)
mesh_16 = Mesh(Mesh=mesh_15, Name="meshStandardMaterial", Material=standardmat_6, DecimalAccuracy=3)

# ----
# MeshStandardMaterial
swatch = ColourSwatch(SwatchColor=RGB(255, 132, 87))
standardmat_7 = MeshStandardMaterial(Color=swatch, Opacity=1, Roughness=1, Metalness=0.5, Emissive=RGB(0, 0, 0), EmissiveIntensity=1)
mesh_17 = Mesh([<mesh referenced from the Rhino model> x3])
mesh_18 = Mesh(Mesh=mesh_17, Name="meshStandardMaterial", Material=standardmat_7, DecimalAccuracy=3)

# ----
# MeshBasicMaterial
swatch_2 = ColourSwatch(SwatchColor=RGB(255, 132, 87))
mesh_19 = Mesh([<mesh referenced from the Rhino model> x3])
basicmat_2 = MeshBasicMaterial(Color=swatch_2)
mesh_20 = Mesh(Mesh=mesh_19, Name="meshBasicMaterial", Material=basicmat_2, DecimalAccuracy=3)

shadow_bottom = Slider(6, range=1..100)
shadow_left = Slider(15, range=1..100)

# ----
# MeshNormalMaterial
panel_4 = Panel("meshNormalMaterial")
normalmat = MeshNormalMaterial(Wireframe=False, WireframeLineJoin="round", WireframeLineWidth=1)
mesh_21 = Mesh([<mesh referenced from the Rhino model> x3])
mesh_22 = Mesh(Mesh=mesh_21, Name=panel_4, Material=normalmat, DecimalAccuracy=3)

mesh_23 = Mesh(<mesh referenced from the Rhino model>)
mesh_24 = Mesh(<mesh referenced from the Rhino model>)
mesh_25 = Mesh(<mesh referenced from the Rhino model>)

# ----
# Brick Texture
panel_5 = Panel("/materials/factory_brick_1k_jpg/factory_brick_diff_1k.jpg")
texturesettings = TextureSettings(WrapS=0, WrapT=0, RepeatU=1, RepeatV=1, OffsetU=1, OffsetV=1, CenterU=1, CenterV=1, Rotation=0)
concat_6 = Concatenate(FragmentA=nickname_2, FragmentB=panel_5)
texture_3 = Texture(ImagePath=concat_6, MapSettings=texturesettings)
texture_4 = Texture(ImagePath=concat_2, MapSettings=texturesettings)
texture_5 = Texture(ImagePath=concat_4, MapSettings=texturesettings)
texture_6 = Texture(ImagePath=concat_3, MapSettings=texturesettings)
meshstandardmaps_4 = MeshStandardMaterialMaps(
    Map=texture_3,
    AlphaTest=0.5,
    BumpMap=texture_4,
    BumpScale=1,
    DisplacementScale=1,
    NormalMap=texture_5,
    EnvMapIntensity=1,
    RoughnessMap=texture_6,
    AoMapIntensity=1)
merge_4 = Merge(Data1=mesh_23, Data2=mesh_24, Data3=mesh_25)
standardmat_8 = MeshStandardMaterial(
    Color=RGB(255, 255, 255),
    Opacity=1,
    Roughness=1,
    Metalness=0.5,
    Emissive=RGB(0, 0, 0),
    EmissiveIntensity=1,
    Maps=meshstandardmaps_4)
mesh_26 = Mesh(Mesh=merge_4, Name="brick", Material=standardmat_8, DecimalAccuracy=3)

# ----
# Floor
panel_6 = Panel("meshStandardMaterial")
standardmat_9 = MeshStandardMaterial(
    Color=ColourSwatch(SwatchColor=RGB(186, 186, 186)),
    Opacity=1,
    Roughness=1,
    Metalness=0.5,
    Emissive=RGB(0, 0, 0),
    EmissiveIntensity=1)
mesh_27 = Mesh(<mesh referenced from the Rhino model>)
mesh_28 = Mesh(Mesh=mesh_27, Name=panel_6, Material=standardmat_9, DecimalAccuracy=3)

# ----
# Mesh Geometry
# Mesh
mesh_29 = Mesh([<mesh referenced from the Rhino model> x3])
mesh_30 = Mesh(Mesh=mesh_29, Name="mesh", DecimalAccuracy=3)

# ----
# Points w/PointsMaterial
number_slider_7 = Slider(0.2, range=0..10)
pointsmat_3 = PointsMaterial(Color=ColourSwatch(SwatchColor=RGB(0, 180, 240)), Size=number_slider_7, SizeAttenuation=True, AlphaTest=0.5)
pt_3 = Point([<point referenced from the Rhino model> x200])

# ----
# Labels
panel_7 = Panel("annotations")
basicmat_3 = MeshBasicMaterial(Color=ColourSwatch(SwatchColor=RGB(255, 255, 255)))
mesh_31 = Mesh([<mesh referenced from the Rhino model> x70])
mesh_32 = Mesh(Mesh=mesh_31, Name=panel_7, Material=basicmat_3, DecimalAccuracy=3)

# ----
# Dividers
swatch_3 = ColourSwatch(SwatchColor=RGB(255, 255, 255))
linebasicmat_2 = LineBasicMaterial(Color=swatch_3, LineWidth=1)
crv_5 = Curve([<curve referenced from the Rhino model> x8])
line_4 = Line(Line=crv_5, LineMaterial=linebasicmat_2, DecimalAccuracy=3)

# ----
# note: You can interpolate the colors on the vertices by welding the mesh edges.
weld = WeldMesh(Mesh=colorface, Angle=3.141592654)

# ----
# HemisphereLight
number_slider_8 = Slider(1.2, range=0..10)
hemilight = HempisphereLight(
    Color=ColourSwatch(SwatchColor=RGB(219, 235, 255)),
    GroundColor=ColourSwatch(SwatchColor=RGB(217, 204, 173)),
    Intensity=number_slider_8)

# ----
# Environmental Lighting
# AmbientLight
number_slider_9 = Slider(0.2, range=0..10)
ambientlight = AmbientLight(Color=ColourSwatch(SwatchColor=RGB(171, 210, 255)), Intensity=number_slider_9)

# ----
# Points Geometry
# Points
pt_4 = Point(graft([<point referenced from the Rhino model> x6]))
points_2 = Points(Points=pt_4, DecimalAccuracy=3)

neg = Negative(Value=shadow_bottom)
neg_2 = Negative(Value=shadow_left)

# ----
# DirectionalLight
number_slider_10 = Slider(0.8, range=0..10)
pt_5 = Point(<point referenced from the Rhino model>)
dirlight = DirectionalLight(
    Position=pt_5,
    Color=ColourSwatch(SwatchColor=RGB(255, 254, 209)),
    Intensity=number_slider_10,
    CastShadow=Toggle(True),
    ShadowTop=Slider(41, range=1..100),
    ShadowBottom=neg,
    ShadowRight=Slider(53, range=1..100),
    ShadowLeft=neg_2,
    ShadowNear=Slider(0, range=0..10),
    ShadowFar=Slider(61, range=0..100))  # -> Helper, Light

points_3 = Points(Points=pt_3, PointsMaterial=pointsmat_3, DecimalAccuracy=3)

# ----
# DirectionalLightHelper
swatch_4 = ColourSwatch(SwatchColor=RGB(255, 229, 0))
preview = CustomPreview(Geometry=dirlight.Helper, Material=swatch_4)

merge_5 = Merge(Data1=meshvertex, Data2=meshvertex_2)
merge_6 = Merge(Data1=line_3, Data2=line, Data3=line_2, Data4=linevertexcolors)
merge_7 = Merge(Data1=ambientlight, Data2=hemilight, Data3=dirlight.Light)
merge_8 = Merge(Data1=mesh_32, Data2=mesh_28, Data3=line_4)
merge_9 = Merge(Data1=mesh_30, Data2=mesh_22, Data3=mesh_20, Data4=mesh_14, Data5=mesh_18, Data6=mesh_16, Data7=mesh_4)
merge_10 = Merge(Data1=mesh_8, Data3=mesh_26, Data4=mesh_12)

# ----
# Serve Your Website
panel_8 = Panel("\www")
concat_7 = Concatenate(FragmentA=nickname_2, FragmentB=panel_8)
http = HTTPServer(Path=concat_7, Port=3000, Run=Button())

# ----
# Points w/PointsMaterial + AlphaMap
panel_9 = Panel("\materials\disc.png")
nickname_5 = RelativePath()
concat_8 = Concatenate(FragmentA=nickname_5, FragmentB=panel_9)
pt_6 = Point([<point referenced from the Rhino model> x200])

texture_7 = Texture(ImagePath=concat_8)

pointsmat_4 = PointsMaterial(
    Color=ColourSwatch(SwatchColor=RGB(240, 0, 128)),
    Size=Slider(0.2, range=0..10),
    SizeAttenuation=True,
    AlphaMap=texture_7,
    AlphaTest=0.5)
points_4 = Points(Points=pt_6, PointsMaterial=pointsmat_4, DecimalAccuracy=3)

# ----
# Points w/PointsMaterial + AlphaMap
panel_10 = Panel("\materials\cross.png")
nickname_6 = RelativePath()
concat_9 = Concatenate(FragmentA=nickname_6, FragmentB=panel_10)
pt_7 = Point([<point referenced from the Rhino model> x200])

texture_8 = Texture(ImagePath=concat_9)

pointsmat_5 = PointsMaterial(
    Color=ColourSwatch(SwatchColor=RGB(240, 240, 0)),
    Size=Slider(0.3, range=0..10),
    SizeAttenuation=True,
    AlphaMap=texture_8,
    AlphaTest=0.5)
points_5 = Points(Points=pt_7, PointsMaterial=pointsmat_5, DecimalAccuracy=3)

merge_11 = Merge(Data1=points_2, Data2=points_3, Data3=points_4, Data4=points_5, Data5=points, Data6=pointvertexcolors)

# ----
# RectAreaLight
swatch_5 = ColourSwatch(SwatchColor=RGB(255, 229, 0))
crv_6 = Curve(<curve referenced from the Rhino model>)
boundary = BoundarySurfaces(Edges=crv_6)
standardmat_10 = MeshStandardMaterial(
    Color=ColourSwatch(SwatchColor=RGB(186, 202, 217)),
    Opacity=1,
    Roughness=1,
    Metalness=0.5,
    Emissive=RGB(0, 0, 0),
    EmissiveIntensity=1)
mesh_33 = MeshBrep(
    Brep=boundary,
    Settings={GridMaxCount=0, GridMinCount=16, JaggedSeams=False, MaxEdgeLength=0, MinEdgeLength=0.0001, MinTolerance=0, Refine=True, RefineAngle=0, RelativeTolerance=0.65, SimplePlanes=True, Tolerance=0})
mesh_34 = Mesh([<mesh referenced from the Rhino model> x4])
arealight = RectAreaLight(Rectangle=crv_6, Color=swatch_5, Intensity=Slider(3, range=0..10))  # -> Helper, Light
mesh_35 = Mesh(Mesh=mesh_34, Material=standardmat_10, DecimalAccuracy=3)

basicmat_4 = MeshBasicMaterial(Color=swatch_5)

mesh_36 = Mesh(Mesh=mesh_33, Material=basicmat_4, DecimalAccuracy=3)

# ----
# RectAreaLightHelper
swatch_6 = ColourSwatch(SwatchColor=RGB(255, 229, 0))
preview_2 = CustomPreview(Geometry=arealight.Helper, Material=swatch_6)

merge_12 = Merge(Data1=mesh_36, Data2=arealight.Light, Data3=mesh_35)  # -> flatten(Result)

# ----
# SpotLight
swatch_7 = ColourSwatch(SwatchColor=RGB(0, 162, 255))
pt_8 = Point(<point referenced from the Rhino model>)
standardmat_11 = MeshStandardMaterial(
    Color=ColourSwatch(SwatchColor=RGB(186, 202, 217)),
    Opacity=1,
    Roughness=1,
    Metalness=0.5,
    Emissive=RGB(0, 0, 0),
    EmissiveIntensity=1)
# Local Lighting
msphere = MeshSphere(Base=pt_8, Radius=0.1, UCount=10, VCount=20)
mesh_37 = Mesh([<mesh referenced from the Rhino model> x4])
mesh_38 = Mesh(Mesh=mesh_37, Material=standardmat_11, DecimalAccuracy=3)
spotlight = SpotLight(
    Position=pt_8,
    Color=swatch_7,
    Intensity=Slider(3, range=0..10),
    Angle=Slider(30, range=0..100),
    Distance=0,
    Decay=1,
    CastShadow=Toggle(True),
    Name="SpotLight1")  # -> Helper, Light

basicmat_5 = MeshBasicMaterial(Color=swatch_7)

mesh_39 = Mesh(Mesh=msphere, Material=basicmat_5, DecimalAccuracy=3)

# ----
# SpotLightHelper
swatch_8 = ColourSwatch(SwatchColor=RGB(255, 229, 0))
preview_3 = CustomPreview(Geometry=spotlight.Helper, Material=swatch_8)

merge_13 = Merge(Data1=mesh_39, Data2=spotlight.Light, Data3=mesh_38)  # -> flatten(Result)

# ----
# PointLight
swatch_9 = ColourSwatch(SwatchColor=RGB(255, 13, 0))
pt_9 = Point(<point referenced from the Rhino model>)
standardmat_12 = MeshStandardMaterial(
    Color=ColourSwatch(SwatchColor=RGB(186, 202, 217)),
    Opacity=1,
    Roughness=1,
    Metalness=0.5,
    Emissive=RGB(0, 0, 0),
    EmissiveIntensity=1)
mesh_40 = Mesh([<mesh referenced from the Rhino model> x4])
ptlight = PointLight(
    Position=pt_9,
    Color=swatch_9,
    Intensity=Slider(5, range=0..10),
    Distance=Slider(5, range=0..10),
    Decay=Slider(1, range=0..10),
    CastShadow=Toggle(True),
    Name="PointLight1")  # -> Helper, Light
mesh_41 = Mesh(Mesh=mesh_40, Material=standardmat_12, DecimalAccuracy=3)

basicmat_6 = MeshBasicMaterial(Color=swatch_9)
msphere_2 = MeshSphere(Base=pt_9, Radius=0.1, UCount=10, VCount=20)

mesh_42 = Mesh(Mesh=msphere_2, Material=basicmat_6, DecimalAccuracy=3)

# ----
# PointLightHelper
swatch_10 = ColourSwatch(SwatchColor=RGB(255, 229, 0))
preview_4 = CustomPreview(Geometry=ptlight.Helper, Material=swatch_10)

merge_14 = Merge(Data1=mesh_42, Data2=ptlight.Light, Data3=mesh_41)  # -> flatten(Result)
merge_15 = Merge(
    Data1=merge_9,
    Data2=merge_10,
    Data3=merge_5,
    Data4=merge_6,
    Data5=merge_11,
    Data6=merge_7,
    Data7=merge_13,
    Data8=merge_14,
    Data9=merge_12,
    Data10=merge_8)

# ----
# Compile Scene and Export
number_slider_11 = Slider(20, range=0..100)
swatch_11 = ColourSwatch(SwatchColor=RGB(255, 255, 255))
fog = Fog(Color=swatch_11, Near=number_slider_11, Far=Slider(200, range=0..1000))
scene = CompileScene(Objects=flatten(merge_15), Name="example_scene", BackgroundColor=swatch_11, Fog=fog)
button = Button()
serialize = SerializeObject(Data=scene, Minify=Toggle(False), Run=button)
concat_10 = Concatenate(FragmentA=nickname_2, FragmentB="\www\assets")
json = ExportJSON(Path=concat_10, FileName="example_scene.json", Data=serialize, Write=button)

# ==== cluster Cluster
G = ClusterInput()
area = Area(Geometry=G)  # -> Area, Centroid
pdecon = Deconstruct(Point=area.Centroid)  # -> XComponent, YComponent, ZComponent
sort = SortList(Keys=pdecon.YComponent)  # -> Keys, ValuesA
sort_2 = SortList(Keys=pdecon.XComponent)  # -> Keys, ValuesA
item = ListItem(List=reverse(sort.Keys), Index=0, Wrap=True)
item_2 = ListItem(List=reverse(sort_2.Keys), Index=0, Wrap=True)
item_3 = ListItem(List=sort.Keys, Index=0, Wrap=True)
item_4 = ListItem(List=sort_2.Keys, Index=0, Wrap=True)
dom = ConstructDomain(DomainStart=item_3, DomainEnd=item)
dom_2 = ConstructDomain(DomainStart=item_4, DomainEnd=item_2)
remap = RemapNumbers(Value=pdecon.XComponent, Source=dom_2, Target=Domain(0, 1))  # -> Mapped, Clipped
remap_2 = RemapNumbers(Value=pdecon.YComponent, Source=dom, Target=Domain(0, 1))  # -> Mapped, Clipped
R = ClusterOutput(remap.Mapped)
R_2 = ClusterOutput(remap_2.Mapped)
