# Grasshopper definition house.gh (Grasshopper 1.0.7)
# plug-ins: glTFexporter

# ----
# GH File Location
nickname = RelativePath()

number_slider = Slider(20, range=0..100)
panel = Panel("\materials\roof_slates_02_1k_jpg\roof_slates_02_rough_1k.jpg")
panel_2 = Panel("\materials\roof_slates_02_1k_jpg\roof_slates_02_diff_1k.jpg")
panel_3 = Panel("\materials\brown_planks_05_2k_jpg\brown_planks_05_diff_2k.jpg")
panel_4 = Panel("\materials\brown_planks_05_2k_jpg\brown_planks_05_nor_2k.jpg")
panel_5 = Panel("\materials\brown_planks_05_2k_jpg\brown_planks_05_rough_2k.jpg")
texturesettings = TextureSettings(WrapS=0, WrapT=0, RepeatU=number_slider, RepeatV=number_slider, OffsetU=1, OffsetV=1, CenterU=1, CenterV=1, Rotation=0)
imgsettings = ImageSettings(Saturation=1, Contrast=Slider(-0.81, range=-1..1), Lightness=Slider(0.39, range=-1..1))
concat = Concatenate(FragmentA=nickname, FragmentB=panel_5)
concat_2 = Concatenate(FragmentA=nickname, FragmentB=panel_3)
concat_3 = Concatenate(FragmentA=nickname, FragmentB=panel_4)
imgsettings_2 = ImageSettings(Saturation=1, Contrast=Slider(-0.75, range=-1..1), Lightness=0)
concat_4 = Concatenate(FragmentA=nickname, FragmentB=panel)
concat_5 = Concatenate(FragmentA=nickname, FragmentB=panel_2)
concat_6 = Concatenate(FragmentA=nickname, FragmentB="\materials\roof_slates_02_1k_jpg\roof_slates_02_nor_1k.jpg")
texture = Texture(ImagePath=concat, MapSettings=texturesettings)
texture_2 = Texture(ImagePath=concat_2, ImageSettings=imgsettings, MapSettings=texturesettings)
texture_3 = Texture(ImagePath=concat_3, MapSettings=texturesettings)
texture_4 = Texture(ImagePath=concat_4)
texture_5 = Texture(ImagePath=concat_5, ImageSettings=imgsettings_2)
texture_6 = Texture(ImagePath=concat_6)
meshstandardmaps = MeshStandardMaterialMaps(
    Map=texture_2,
    AlphaTest=0.5,
    BumpScale=1,
    DisplacementScale=1,
    NormalMap=texture_3,
    EnvMapIntensity=1,
    RoughnessMap=texture,
    AoMapIntensity=1)
meshstandardmaps_2 = MeshStandardMaterialMaps(
    Map=texture_5,
    AlphaTest=0.5,
    BumpScale=1,
    DisplacementScale=1,
    NormalMap=texture_6,
    EnvMapIntensity=1,
    RoughnessMap=texture_4,
    AoMapIntensity=1)
swatch = ColourSwatch(SwatchColor=RGB(250, 180, 213))
swatch_2 = ColourSwatch(SwatchColor=RGB(230, 222, 168))
brep = Brep([<brep referenced from the Rhino model> x2])
crv = Curve([<curve referenced from the Rhino model> x2])
mesh = Mesh([<mesh referenced from the Rhino model> x6])
brep_2 = Brep(<brep referenced from the Rhino model>)
pt = Point([<point referenced from the Rhino model> x8])
standardmat = MeshStandardMaterial(Color=swatch, Opacity=1, Roughness=1, Metalness=0.5, Emissive=RGB(0, 0, 0), EmissiveIntensity=1)
mesh_2 = Mesh([<mesh referenced from the Rhino model> x133])
standardmat_2 = MeshStandardMaterial(Color=swatch_2, Opacity=1, Roughness=1, Metalness=0.5, Emissive=RGB(0, 0, 0), EmissiveIntensity=1)
shadowmat = ShadowMaterial(Color=RGB(0, 0, 0), Opacity=Slider(0.1, range=0..1))
neg = Negative(Value=Slider(10, range=0..100))
neg_2 = Negative(Value=Slider(20, range=0..100))
standardmat_3 = MeshStandardMaterial(
    Color=ColourSwatch(SwatchColor=RGB(255, 249, 217)),
    Opacity=1,
    Roughness=1,
    Metalness=0.5,
    Emissive=RGB(0, 0, 0),
    EmissiveIntensity=1,
    Maps=meshstandardmaps)
standardmat_4 = MeshStandardMaterial(
    Color=ColourSwatch(SwatchColor=RGB(140, 132, 112)),
    Opacity=1,
    Roughness=1,
    Metalness=0.5,
    Emissive=RGB(0, 0, 0),
    EmissiveIntensity=1)
standardmat_5 = MeshStandardMaterial(
    Color=ColourSwatch(SwatchColor=RGB(209, 206, 180)),
    Opacity=1,
    Roughness=1,
    Metalness=0.5,
    Emissive=RGB(0, 0, 0),
    EmissiveIntensity=1)
standardmat_6 = MeshStandardMaterial(
    Color=ColourSwatch(SwatchColor=RGB(230, 230, 230)),
    Opacity=1,
    Roughness=1,
    Metalness=0.5,
    Emissive=RGB(0, 0, 0),
    EmissiveIntensity=1)
standardmat_7 = MeshStandardMaterial(
    Color=ColourSwatch(SwatchColor=RGB(115, 115, 115)),
    Opacity=1,
    Roughness=1,
    Metalness=0.5,
    Emissive=RGB(0, 0, 0),
    EmissiveIntensity=1,
    Maps=meshstandardmaps_2)
pointsmat = PointsMaterial(Color=swatch_2, Size=Slider(0.05, range=0..0.1), SizeAttenuation=True, AlphaTest=0.5)
brep_3 = Brep([<brep referenced from the Rhino model> x11])
basicmat = MeshBasicMaterial(Color=ColourSwatch(SwatchColor=RGB(0, 0, 0)))
linebasicmat = LineBasicMaterial(Color=swatch, LineWidth=1)
pt_2 = Point(<point referenced from the Rhino model>)
brep_4 = Brep([<brep referenced from the Rhino model> x11])
standardmat_8 = MeshStandardMaterial(
    Color=ColourSwatch(SwatchColor=RGB(224, 224, 224)),
    Opacity=1,
    Roughness=Slider(0.5, range=0..1),
    Metalness=0.5,
    Emissive=RGB(0, 0, 0),
    EmissiveIntensity=1)
crv_2 = Curve([<curve referenced from the Rhino model> x34])
brep_5 = Brep([<brep referenced from the Rhino model> x12])
mesh_3 = Mesh(brep_2)
standardmat_9 = MeshStandardMaterial(
    Color=ColourSwatch(SwatchColor=RGB(145, 145, 145)),
    Opacity=1,
    Roughness=1,
    Metalness=0.5,
    Emissive=RGB(0, 0, 0),
    EmissiveIntensity=1)
brep_6 = Brep([<brep referenced from the Rhino model> x24])
brep_7 = Brep([<brep referenced from the Rhino model> x58])
standardmat_10 = MeshStandardMaterial(
    Color=ColourSwatch(SwatchColor=RGB(112, 112, 112)),
    Opacity=1,
    Roughness=1,
    Metalness=0.5,
    Emissive=RGB(0, 0, 0),
    EmissiveIntensity=1)
brep_8 = Brep([<brep referenced from the Rhino model> x16])
brep_9 = Brep([<brep referenced from the Rhino model> x2])
linedashmat = LineDashedMaterial(
    Color=ColourSwatch(SwatchColor=RGB(86, 156, 196)),
    LineWidth=1,
    DashSize=Slider(1, range=0..1),
    GapSize=Slider(0.5, range=0..1))
topoly = CurveToPolyline(Curve=crv, ToleranceDistance=0, ToleranceAngle=Slider(0.1, range=0..1))  # -> Polyline, Segments
brep_10 = Brep([<brep referenced from the Rhino model> x2])
linebasicmat_2 = LineBasicMaterial(Color=ColourSwatch(SwatchColor=RGB(173, 173, 173)), LineWidth=1)
mesh_4 = Mesh(brep)
crv_3 = Curve([<curve referenced from the Rhino model> x3])
mesh_5 = Mesh(Mesh=mesh_3, Material=shadowmat, DecimalAccuracy=3)
dirlight = DirectionalLight(
    Position=pt_2,
    Color=RGB(255, 255, 255),
    Intensity=Slider(0.7, range=0..1),
    CastShadow=Toggle(True),
    ShadowTop=Slider(14, range=0..100),
    ShadowBottom=neg,
    ShadowRight=Slider(18, range=0..100),
    ShadowLeft=neg_2,
    ShadowNear=0,
    ShadowFar=Slider(50, range=0..1000))  # -> Helper, Light
hemilight = HempisphereLight(
    Color=ColourSwatch(SwatchColor=RGB(237, 248, 255)),
    GroundColor=ColourSwatch(SwatchColor=RGB(217, 205, 189)),
    Intensity=Slider(2.2, range=0..10))
mesh_6 = Mesh(Mesh=mesh_2, Name="furniture", Material=standardmat, DecimalAccuracy=3)
mesh_7 = Mesh(Mesh=mesh, Name="objects", Material=standardmat_2, DecimalAccuracy=3)
line = Line(Line=flatten(crv_3), LineMaterial=linedashmat, DecimalAccuracy=3)
line_2 = Line(Line=flatten(topoly.Polyline), Name="driveway", LineMaterial=linebasicmat_2, DecimalAccuracy=3)
line_3 = Line(Line=crv_2, Name="strings", LineMaterial=linebasicmat, DecimalAccuracy=3)
mesh_8 = Mesh(Mesh=brep_6, Name="floors", Material=standardmat_3, DecimalAccuracy=3)
mesh_9 = Mesh(Mesh=brep_8, Name="wood", Material=standardmat_4, DecimalAccuracy=3)
mesh_10 = Mesh(Mesh=brep_7, Name="joists", Material=standardmat_5, DecimalAccuracy=3)
mesh_11 = Mesh(Mesh=brep_3, Name="plaster", Material=standardmat_6, DecimalAccuracy=3)
mesh_12 = Mesh(Mesh=brep_4, Name="shingles", Material=standardmat_7, DecimalAccuracy=3)
mesh_13 = Mesh(Mesh=brep_5, Name="black", Material=basicmat, DecimalAccuracy=3)
mesh_14 = Mesh(Mesh=brep_10, Name="pavers", Material=standardmat_9, DecimalAccuracy=3)
points = Points(Points=pt, Name="sparks", PointsMaterial=pointsmat, DecimalAccuracy=3)
mesh_15 = Mesh(Mesh=brep_9, Name="counters", Material=standardmat_8, DecimalAccuracy=3)
mesh_16 = Mesh(Mesh=mesh_4, Name="concrete", Material=standardmat_10, DecimalAccuracy=3)
preview = CustomPreview(
    Geometry=dirlight.Helper,
    Material={diffuse=RGB(221, 160, 221), emission=RGB(66, 48, 66), shine=0.5, specular=RGB(255, 255, 255), transparency=0})
merge = Merge(Data1=mesh_6, Data2=line_3, Data3=mesh_7, Data4=points)
merge_2 = Merge(Data1=mesh_5, Data2=dirlight.Light, Data3=hemilight)
merge_3 = Merge(Data1=mesh_8, Data2=mesh_9, Data3=mesh_10, Data4=mesh_11, Data5=mesh_12, Data6=mesh_13, Data8=mesh_15)
merge_4 = Merge(Data1=mesh_16, Data2=mesh_14, Data3=line_2, Data4=line)
merge_5 = Merge(Data1=merge_3, Data2=merge_4, Data3=merge_2, Data4=merge)

# ---- group: Create and Export Scene
button = Button()
scene = CompileScene(Objects=merge_5)
serialize = SerializeObject(Object3d=scene, Minify=False, Run=button)
concat_7 = Concatenate(FragmentA=nickname, FragmentB="\www\assets")
writetxt = WriteTextFile(Path=concat_7, FileName="house.json", Data=serialize, Write=button)

# ---- group: Server Your Website
concat_8 = Concatenate(FragmentA=nickname, FragmentB="\www")
http = HTTPServer(Path=concat_8, Port=3000, Run=Toggle(False))
