# Grasshopper definition water_tower.gh (Grasshopper 1.0.7)
# plug-ins: glTFexporter, Human

path = FilePath("C:\Users\dee\Desktop\vue-threejs-template\public\images\brooklyn_cube_small\left.jpg")
path_2 = FilePath("C:\Users\dee\Desktop\vue-threejs-template\public\images\brooklyn_cube_small\right.jpg")
path_3 = FilePath("C:\Users\dee\Desktop\vue-threejs-template\public\images\brooklyn_cube_small\rear.jpg")
path_4 = FilePath("C:\Users\dee\Desktop\vue-threejs-template\public\images\brooklyn_cube_small\top.jpg")
path_5 = FilePath("C:\Users\dee\Desktop\vue-threejs-template\public\images\brooklyn_cube_small\bottom.jpg")
path_6 = FilePath("C:\Users\dee\Desktop\vue-threejs-template\public\images\brooklyn_cube_small\front.jpg")
nickname = CubeTexture_Component(Left=path, Front=path_6, Right=path_2, Rear=path_3, Top=path_4, Bottom=path_5, Name="Brooklyn skyline")
data = Data(nickname)

texturesettings = TextureSettings(
    WrapS=0,
    WrapT=0,
    RepeatU=Slider(1.5, range=0..20),
    RepeatV=Slider(1, range=0..20),
    OffsetU=1,
    OffsetV=1,
    CenterU=1,
    CenterV=1,
    Rotation=0)
path_7 = FilePath("C:\Users\dee\Desktop\Triceratops\examples\Materials\Wood\brown_planks_09_1k_jpg\brown_planks_09_diff_1k.jpg")
path_8 = FilePath("C:\Users\dee\Desktop\Triceratops\examples\Materials\Wood\brown_planks_09_1k_jpg\brown_planks_09_disp_1k.jpg")
path_9 = FilePath("C:\Users\dee\Desktop\Triceratops\examples\Materials\Wood\brown_planks_09_1k_jpg\brown_planks_09_nor_1k.jpg")
path_10 = FilePath("C:\Users\dee\Desktop\Triceratops\examples\Materials\Wood\brown_planks_09_1k_jpg\brown_planks_09_rough_1k.jpg")
path_11 = FilePath("C:\Users\dee\Desktop\Triceratops\examples\Materials\Wood\dark_planks_1k_jpg\dark_planks_spec_1k.jpg")
texture = Texture(ImagePath=path_7, Settings=texturesettings)
texture_2 = Texture(ImagePath=path_8, Settings=texturesettings)
texture_3 = Texture(ImagePath=path_9, Settings=texturesettings)
texture_4 = Texture(ImagePath=path_10, Settings=texturesettings)
texture_5 = Texture(ImagePath=path_11, Settings=texturesettings)
meshstandardmaps = MeshStandardMaterialMaps(
    Map=texture,
    AlphaTest=0.5,
    BumpMap=texture_2,
    BumpScale=1,
    DisplacementScale=1,
    NormalMap=texture_3,
    EnvMapIntensity=1,
    RoughnessMap=texture_4,
    MetalnessMap=texture_5,
    AoMapIntensity=1)
standardmat = MeshStandardMaterial(
    Color=ColourSwatch(SwatchColor=RGB(171, 171, 171)),
    Opacity=1,
    Roughness=1,
    Metalness=0.5,
    Emissive=RGB(0, 0, 0),
    EmissiveIntensity=1,
    Maps=meshstandardmaps)
mesh = Mesh([<mesh referenced from the Rhino model> x8])
mesh_2 = Mesh(Mesh=mesh, Name="siding", Material=standardmat, DecimalAccuracy=3)

number_slider = Slider(3, range=0..10)
texturesettings_2 = TextureSettings(WrapS=0, WrapT=0, RepeatU=number_slider, RepeatV=number_slider, OffsetU=1, OffsetV=1, CenterU=1, CenterV=1, Rotation=0)
path_12 = FilePath("C:\Users\dee\Desktop\Triceratops\examples\Materials\Wood\green_rough_planks_1k_jpg\green_rough_planks_diff_1k.jpg")
path_13 = FilePath("C:\Users\dee\Desktop\Triceratops\examples\Materials\Wood\green_rough_planks_1k_jpg\green_rough_planks_bump_1k.jpg")
path_14 = FilePath("C:\Users\dee\Desktop\Triceratops\examples\Materials\Wood\green_rough_planks_1k_jpg\green_rough_planks_nor_1k.jpg")
path_15 = FilePath("C:\Users\dee\Desktop\Triceratops\examples\Materials\Wood\green_rough_planks_1k_jpg\green_rough_planks_rough_1k.jpg")
path_16 = FilePath("C:\Users\dee\Desktop\Triceratops\examples\Materials\Wood\green_rough_planks_1k_jpg\green_rough_planks_spec_1k.jpg")
texture_6 = Texture(ImagePath=path_12, Settings=texturesettings_2)
texture_7 = Texture(ImagePath=path_13, Settings=texturesettings_2)
texture_8 = Texture(ImagePath=path_14, Settings=texturesettings_2)
texture_9 = Texture(ImagePath=path_15, Settings=texturesettings_2)
texture_10 = Texture(ImagePath=path_16, Settings=texturesettings_2)
meshstandardmaps_2 = MeshStandardMaterialMaps(
    Map=texture_6,
    AlphaTest=0.5,
    BumpMap=texture_7,
    BumpScale=1,
    DisplacementScale=1,
    NormalMap=texture_8,
    EnvMapIntensity=1,
    RoughnessMap=texture_9,
    MetalnessMap=texture_10,
    AoMapIntensity=1)
standardmat_2 = MeshStandardMaterial(
    Color=ColourSwatch(SwatchColor=RGB(219, 219, 219)),
    Opacity=1,
    Roughness=1,
    Metalness=0.5,
    Emissive=RGB(0, 0, 0),
    EmissiveIntensity=1,
    Maps=meshstandardmaps_2)
mesh_3 = Mesh([<mesh referenced from the Rhino model> x2])
mesh_4 = Mesh(Mesh=mesh_3, Name="floors", Material=standardmat_2, DecimalAccuracy=3)

texturesettings_3 = TextureSettings(
    WrapS=0,
    WrapT=0,
    RepeatU=Slider(1.5, range=0..20),
    RepeatV=Slider(1, range=0..20),
    OffsetU=1,
    OffsetV=1,
    CenterU=1,
    CenterV=1,
    Rotation=Slider(90, range=0..100))
path_17 = FilePath("C:\Users\dee\Desktop\Triceratops\examples\Materials\Wood\brown_planks_09_1k_jpg\brown_planks_09_diff_1k.jpg")
path_18 = FilePath("C:\Users\dee\Desktop\Triceratops\examples\Materials\Wood\brown_planks_09_1k_jpg\brown_planks_09_disp_1k.jpg")
path_19 = FilePath("C:\Users\dee\Desktop\Triceratops\examples\Materials\Wood\brown_planks_09_1k_jpg\brown_planks_09_nor_1k.jpg")
path_20 = FilePath("C:\Users\dee\Desktop\Triceratops\examples\Materials\Wood\dark_planks_1k_jpg\dark_planks_spec_1k.jpg")
path_21 = FilePath("C:\Users\dee\Desktop\Triceratops\examples\Materials\Wood\brown_planks_09_1k_jpg\brown_planks_09_rough_1k.jpg")
texture_11 = Texture(ImagePath=path_17, Settings=texturesettings_3)
texture_12 = Texture(ImagePath=path_18, Settings=texturesettings_3)
texture_13 = Texture(ImagePath=path_19, Settings=texturesettings_3)
texture_14 = Texture(ImagePath=path_21, Settings=texturesettings_3)
texture_15 = Texture(ImagePath=path_20, Settings=texturesettings_3)
meshstandardmaps_3 = MeshStandardMaterialMaps(
    Map=texture_11,
    AlphaTest=0.5,
    BumpMap=texture_12,
    BumpScale=1,
    DisplacementScale=1,
    NormalMap=texture_13,
    EnvMapIntensity=1,
    RoughnessMap=texture_14,
    MetalnessMap=texture_15,
    AoMapIntensity=1)
swatch = ColourSwatch(SwatchColor=RGB(219, 219, 219))
mesh_5 = Mesh([<mesh referenced from the Rhino model> x49])
standardmat_3 = MeshStandardMaterial(
    Color=ColourSwatch(SwatchColor=RGB(156, 156, 156)),
    Opacity=1,
    Roughness=1,
    Metalness=0.5,
    Emissive=RGB(0, 0, 0),
    EmissiveIntensity=1,
    Maps=meshstandardmaps_3)
mesh_6 = Mesh(Mesh=mesh_5, Name="boards", Material=standardmat_3, DecimalAccuracy=3)

texturesettings_4 = TextureSettings(
    WrapS=0,
    WrapT=0,
    RepeatU=Slider(6, range=0..20),
    RepeatV=Slider(15, range=0..20),
    OffsetU=1,
    OffsetV=1,
    CenterU=1,
    CenterV=1,
    Rotation=Slider(90, range=0..100))
path_22 = FilePath("C:\Users\dee\Desktop\Triceratops\examples\Materials\Wood\brown_planks_04_4k_jpg\brown_planks_04_diff_4k.jpg")
path_23 = FilePath("C:\Users\dee\Desktop\Triceratops\examples\Materials\Wood\brown_planks_04_4k_jpg\brown_planks_04_disp_4k.jpg")
path_24 = FilePath("C:\Users\dee\Desktop\Triceratops\examples\Materials\Wood\brown_planks_04_4k_jpg\brown_planks_04_nor_4k.jpg")
path_25 = FilePath("C:\Users\dee\Desktop\Triceratops\examples\Materials\Wood\brown_planks_04_4k_jpg\brown_planks_04_rough_4k.jpg")
texture_16 = Texture(ImagePath=path_22, Settings=texturesettings_4)
texture_17 = Texture(ImagePath=path_23, Settings=texturesettings_4)
texture_18 = Texture(ImagePath=path_24, Settings=texturesettings_4)
texture_19 = Texture(ImagePath=path_25, Settings=texturesettings_4)
meshstandardmaps_4 = MeshStandardMaterialMaps(
    Map=texture_16,
    AlphaTest=0.5,
    BumpMap=texture_17,
    BumpScale=1,
    DisplacementScale=1,
    NormalMap=texture_18,
    EnvMapIntensity=1,
    RoughnessMap=texture_19,
    AoMapIntensity=1)
standardmat_4 = MeshStandardMaterial(
    Color=RGB(255, 255, 255),
    Opacity=1,
    Roughness=1,
    Metalness=0.5,
    Emissive=RGB(0, 0, 0),
    EmissiveIntensity=1,
    Maps=meshstandardmaps_4)
mesh_7 = Mesh(<mesh referenced from the Rhino model>)
mesh_8 = Mesh(Mesh=mesh_7, Name="water tower", Material=standardmat_4, DecimalAccuracy=3)

swatch_2 = ColourSwatch(SwatchColor=RGB(255, 255, 255))

# ----
# Cast Shadows
pt = Point([<point referenced from the Rhino model> x2])
ptlight = PointLight(
    Position=pt,
    Color=swatch_2,
    Intensity=Slider(0.6, range=0..10),
    Distance=Slider(10, range=0..10),
    Decay=Slider(1, range=0..10),
    CastShadow=Toggle(True),
    Name="cast shadows")  # -> Helper, Light

shadow_bottom = Slider(21, range=1..100)
shadow_left = Slider(2, range=1..100)

path_26 = FilePath("C:\Users\dee\Desktop\Triceratops\examples\Materials\Stone\terrain_red_01_1k_jpg\terrain_red_01_diff_1k.jpg")
path_27 = FilePath("C:\Users\dee\Desktop\Triceratops\examples\Materials\Stone\terrain_red_01_1k_jpg\terrain_red_01_bump_1k.jpg")
path_28 = FilePath("C:\Users\dee\Desktop\Triceratops\examples\Materials\Stone\terrain_red_01_1k_jpg\terrain_red_01_nor_1k.jpg")
path_29 = FilePath("C:\Users\dee\Desktop\Triceratops\examples\Materials\Stone\terrain_red_01_1k_jpg\terrain_red_01_spec_1k.jpg")
path_30 = FilePath("C:\Users\dee\Desktop\Triceratops\examples\Materials\Stone\terrain_red_01_1k_jpg\terrain_red_01_rough_1k.jpg")
texture_20 = Texture(ImagePath=path_26)
texture_21 = Texture(ImagePath=path_27)
texture_22 = Texture(ImagePath=path_28)
texture_23 = Texture(ImagePath=path_30)
texture_24 = Texture(ImagePath=path_29)
meshstandardmaps_5 = MeshStandardMaterialMaps(
    Map=texture_20,
    AlphaTest=0.5,
    BumpMap=texture_21,
    BumpScale=1,
    DisplacementScale=1,
    NormalMap=texture_22,
    EnvMapIntensity=1,
    RoughnessMap=texture_23,
    MetalnessMap=texture_24,
    AoMapIntensity=1)
standardmat_5 = MeshStandardMaterial(
    Color=ColourSwatch(SwatchColor=RGB(168, 168, 168)),
    Opacity=1,
    Roughness=1,
    Metalness=0.5,
    Emissive=RGB(0, 0, 0),
    EmissiveIntensity=1,
    Maps=meshstandardmaps_5)
mesh_9 = Mesh([<mesh referenced from the Rhino model> x2])
mesh_10 = Mesh(Mesh=mesh_9, Name="roof", Material=standardmat_5, DecimalAccuracy=3)

# ----
# Rope
number_slider_2 = Slider(3, range=0..10)
crv = Curve([<curve referenced from the Rhino model> x14])
rad = Radians(Degrees=number_slider_2)
topoly = CurveToPolyline(Curve=crv, ToleranceDistance=0, ToleranceAngle=rad)  # -> Polyline, Segments
linebasicmat = LineBasicMaterial(Color=ColourSwatch(SwatchColor=RGB(68, 89, 105)), LineWidth=1)
line = Line(Line=topoly.Polyline, Name="rope", LineMaterial=linebasicmat, DecimalAccuracy=3)

basicmat = MeshBasicMaterial(Color=ColourSwatch(SwatchColor=RGB(254, 255, 201)))
basicmat_2 = MeshBasicMaterial(Color=ColourSwatch(SwatchColor=RGB(255, 89, 0)))
mesh_11 = Mesh([<mesh referenced from the Rhino model> x30])

# ----
# Light Bulbs
pt_2 = Point([<point referenced from the Rhino model> x28])
ptlight_2 = PointLight(
    Position=pt_2,
    Color=swatch_2,
    Intensity=Slider(0.1, range=0..10),
    Distance=Slider(10, range=0..10),
    Decay=Slider(1, range=0..10),
    CastShadow=Toggle(False),
    Name="PointLight1")  # -> Helper, Light
mesh_12 = Mesh(Mesh=mesh_11, Name="light bulb", Material=basicmat, DecimalAccuracy=3)

mesh_13 = Mesh(<mesh referenced from the Rhino model>)

# ----
# Environmental Lighting
# HemisphereLight
number_slider_3 = Slider(0.2, range=0..10)
hemilight = HempisphereLight(
    Color=ColourSwatch(SwatchColor=RGB(59, 105, 150)),
    GroundColor=ColourSwatch(SwatchColor=RGB(94, 70, 34)),
    Intensity=number_slider_3)

path_31 = FilePath("C:\Users\dee\Desktop\Triceratops\examples\Materials\Metal\rusty_metal_02_1k_jpg\rusty_metal_02_rough_1k.jpg")
path_32 = FilePath("C:\Users\dee\Desktop\Triceratops\examples\Materials\Metal\rusty_metal_02_1k_jpg\rusty_metal_02_spec_1k.jpg")
path_33 = FilePath("C:\Users\dee\Desktop\Triceratops\examples\Materials\Metal\rusty_metal_02_1k_jpg\rusty_metal_02_diff_1k.jpg")
path_34 = FilePath("C:\Users\dee\Desktop\Triceratops\examples\Materials\Metal\rusty_metal_02_1k_jpg\rusty_metal_02_disp_1k.jpg")
path_35 = FilePath("C:\Users\dee\Desktop\Triceratops\examples\Materials\Metal\rusty_metal_02_1k_jpg\rusty_metal_02_nor_1k.jpg")
texture_25 = Texture(ImagePath=path_33)
texture_26 = Texture(ImagePath=path_34)
texture_27 = Texture(ImagePath=path_35)
texture_28 = Texture(ImagePath=path_31)
texture_29 = Texture(ImagePath=path_32)
mesh_14 = Mesh([<mesh referenced from the Rhino model> x7])
meshstandardmaps_6 = MeshStandardMaterialMaps(
    Map=texture_25,
    AlphaTest=0.5,
    BumpMap=texture_26,
    BumpScale=1,
    DisplacementScale=1,
    NormalMap=texture_27,
    EnvMapIntensity=1,
    RoughnessMap=texture_28,
    MetalnessMap=texture_29,
    AoMapIntensity=1)
bbox = BoundingBox(Content=mesh_14, Plane=PlaneXY(0, 0, 0))  # -> Box, Box_2
standardmat_6 = MeshStandardMaterial(
    Color=ColourSwatch(SwatchColor=RGB(112, 112, 112)),
    Opacity=1,
    Roughness=1,
    Metalness=0.5,
    Emissive=RGB(0, 0, 0),
    EmissiveIntensity=1,
    Maps=meshstandardmaps_6)
boxmap = BoxMapping(Mesh=mesh_14, Box=bbox.Box)
mesh_15 = Mesh(Mesh=boxmap, Name="metal structure", Material=standardmat_6, DecimalAccuracy=3)

path_36 = FilePath("C:\Users\dee\Desktop\Triceratops\examples\Materials\Wood\rough_wood_1k_jpg\rough_wood_Diff_1k.jpg")
path_37 = FilePath("C:\Users\dee\Desktop\Triceratops\examples\Materials\Wood\rough_wood_1k_jpg\rough_wood_bump_1k.jpg")
path_38 = FilePath("C:\Users\dee\Desktop\Triceratops\examples\Materials\Wood\rough_wood_1k_jpg\rough_wood_nor_1k.jpg")
path_39 = FilePath("C:\Users\dee\Desktop\Triceratops\examples\Materials\Wood\rough_wood_1k_jpg\rough_wood_rough_1k.jpg")
path_40 = FilePath("C:\Users\dee\Desktop\Triceratops\examples\Materials\Wood\rough_wood_1k_jpg\rough_wood_spec_1k.jpg")
texture_30 = Texture(ImagePath=path_36)
texture_31 = Texture(ImagePath=path_37)
texture_32 = Texture(ImagePath=path_38)
texture_33 = Texture(ImagePath=path_39)
texture_34 = Texture(ImagePath=path_40)
meshstandardmaps_7 = MeshStandardMaterialMaps(
    Map=texture_30,
    AlphaTest=0.5,
    BumpMap=texture_31,
    BumpScale=1,
    DisplacementScale=1,
    NormalMap=texture_32,
    EnvMapIntensity=1,
    RoughnessMap=texture_33,
    MetalnessMap=texture_34,
    AoMapIntensity=1)
mesh_16 = Mesh([<mesh referenced from the Rhino model> x8])
standardmat_7 = MeshStandardMaterial(
    Color=ColourSwatch(SwatchColor=RGB(255, 249, 209)),
    Opacity=1,
    Roughness=1,
    Metalness=0.5,
    Emissive=RGB(0, 0, 0),
    EmissiveIntensity=1,
    Maps=meshstandardmaps_7)
mesh_17 = Mesh(Mesh=mesh_16, Name="logs", Material=standardmat_7, DecimalAccuracy=3)

path_41 = FilePath("C:\Users\dee\Desktop\Triceratops\examples\Materials\Wood\brown_planks_09_1k_jpg\brown_planks_09_diff_1k.jpg")
path_42 = FilePath("C:\Users\dee\Desktop\Triceratops\examples\Materials\Wood\brown_planks_09_1k_jpg\brown_planks_09_disp_1k.jpg")
path_43 = FilePath("C:\Users\dee\Desktop\Triceratops\examples\Materials\Wood\brown_planks_09_1k_jpg\brown_planks_09_nor_1k.jpg")
path_44 = FilePath("C:\Users\dee\Desktop\Triceratops\examples\Materials\Wood\brown_planks_09_1k_jpg\brown_planks_09_rough_1k.jpg")
path_45 = FilePath("C:\Users\dee\Desktop\Triceratops\examples\Materials\Wood\dark_planks_1k_jpg\dark_planks_spec_1k.jpg")
texture_35 = Texture(ImagePath=path_41)
texture_36 = Texture(ImagePath=path_42)
texture_37 = Texture(ImagePath=path_43)
texture_38 = Texture(ImagePath=path_44)
texture_39 = Texture(ImagePath=path_45)
meshstandardmaps_8 = MeshStandardMaterialMaps(
    Map=texture_35,
    AlphaTest=0.5,
    BumpMap=texture_36,
    BumpScale=1,
    DisplacementScale=1,
    NormalMap=texture_37,
    EnvMapIntensity=1,
    RoughnessMap=texture_38,
    MetalnessMap=texture_39,
    AoMapIntensity=1)
mesh_18 = Mesh([<mesh referenced from the Rhino model> x94])
standardmat_8 = MeshStandardMaterial(
    Color=ColourSwatch(SwatchColor=RGB(105, 74, 54)),
    Opacity=1,
    Roughness=1,
    Metalness=0.5,
    Emissive=RGB(0, 0, 0),
    EmissiveIntensity=1,
    Maps=meshstandardmaps_8)
mesh_19 = Mesh(Mesh=mesh_18, Name="joists", Material=standardmat_8, DecimalAccuracy=3)

neg = Negative(Value=shadow_bottom)
neg_2 = Negative(Value=shadow_left)

# ----
# DirectionalLight
number_slider_4 = Slider(0.8, range=0..10)
pt_3 = Point(<point referenced from the Rhino model>)
dirlight = DirectionalLight(
    Position=pt_3,
    Color=ColourSwatch(SwatchColor=RGB(98, 139, 209)),
    Intensity=number_slider_4,
    CastShadow=Toggle(True),
    ShadowTop=Slider(22, range=1..100),
    ShadowBottom=neg,
    ShadowRight=Slider(40, range=1..100),
    ShadowLeft=neg_2,
    ShadowNear=Slider(0, range=0..10),
    ShadowFar=Slider(61, range=0..100))  # -> Helper, Light

path_46 = FilePath("C:\Users\dee\Desktop\Triceratops\examples\Materials\Brick\wall_bricks_plaster_1k_jpg\wall_bricks_plaster_rough_1k.jpg")
path_47 = FilePath("C:\Users\dee\Desktop\Triceratops\examples\Materials\Brick\wall_bricks_plaster_1k_jpg\wall_bricks_plaster_diff_1k.jpg")
path_48 = FilePath("C:\Users\dee\Desktop\Triceratops\examples\Materials\Brick\wall_bricks_plaster_1k_jpg\wall_bricks_plaster_bump_1k.jpg")
path_49 = FilePath("C:\Users\dee\Desktop\Triceratops\examples\Materials\Brick\wall_bricks_plaster_1k_jpg\wall_bricks_plaster_nor_1k.jpg")
path_50 = FilePath("C:\Users\dee\Desktop\Triceratops\examples\Materials\Brick\wall_bricks_plaster_1k_jpg\wall_bricks_plaster_spec_1k.jpg")
texture_40 = Texture(ImagePath=path_47)
texture_41 = Texture(ImagePath=path_48)
texture_42 = Texture(ImagePath=path_49)
texture_43 = Texture(ImagePath=path_46)
texture_44 = Texture(ImagePath=path_50)
meshstandardmaps_9 = MeshStandardMaterialMaps(
    Map=texture_40,
    AlphaTest=0.5,
    BumpMap=texture_41,
    BumpScale=1,
    DisplacementScale=1,
    NormalMap=texture_42,
    EnvMapIntensity=1,
    RoughnessMap=texture_43,
    MetalnessMap=texture_44,
    AoMapIntensity=1)
standardmat_9 = MeshStandardMaterial(
    Color=ColourSwatch(SwatchColor=RGB(176, 176, 176)),
    Opacity=1,
    Roughness=1,
    Metalness=0.5,
    Emissive=RGB(0, 0, 0),
    EmissiveIntensity=1,
    Maps=meshstandardmaps_9)
mesh_20 = Mesh(<mesh referenced from the Rhino model>)
mesh_21 = Mesh(Mesh=mesh_20, Name="white brick", Material=standardmat_9, DecimalAccuracy=3)

path_51 = FilePath("C:\Users\dee\Desktop\Triceratops\examples\Materials\Brick\factory_brick_1k_jpg\factory_brick_diff_1k.jpg")
path_52 = FilePath("C:\Users\dee\Desktop\Triceratops\examples\Materials\Brick\factory_brick_1k_jpg\factory_brick_disp_1k.jpg")
path_53 = FilePath("C:\Users\dee\Desktop\Triceratops\examples\Materials\Brick\factory_brick_1k_jpg\factory_brick_nor_1k.jpg")
path_54 = FilePath("C:\Users\dee\Desktop\Triceratops\examples\Materials\Brick\factory_brick_1k_jpg\factory_brick_rough_1k.jpg")
texture_45 = Texture(ImagePath=path_51)
texture_46 = Texture(ImagePath=path_52)
texture_47 = Texture(ImagePath=path_53)
texture_48 = Texture(ImagePath=path_54)
meshstandardmaps_10 = MeshStandardMaterialMaps(
    Map=texture_45,
    AlphaTest=0.5,
    BumpMap=texture_46,
    BumpScale=1,
    DisplacementScale=1,
    NormalMap=texture_47,
    EnvMapIntensity=1,
    RoughnessMap=texture_48,
    AoMapIntensity=1)
standardmat_10 = MeshStandardMaterial(
    Color=RGB(255, 255, 255),
    Opacity=1,
    Roughness=1,
    Metalness=0.5,
    Emissive=RGB(0, 0, 0),
    EmissiveIntensity=1,
    Maps=meshstandardmaps_10)
mesh_22 = Mesh([<mesh referenced from the Rhino model> x17])
mesh_23 = Mesh(Mesh=mesh_22, Name="brick", Material=standardmat_10, DecimalAccuracy=3)

path_55 = FilePath("C:\Users\dee\Desktop\Triceratops\examples\Materials\Roof\roof_slates_02_1k_jpg\roof_slates_02_diff_1k.jpg")
path_56 = FilePath("C:\Users\dee\Desktop\Triceratops\examples\Materials\Roof\roof_slates_02_1k_jpg\roof_slates_02_disp_1k.jpg")
path_57 = FilePath("C:\Users\dee\Desktop\Triceratops\examples\Materials\Roof\roof_slates_02_1k_jpg\roof_slates_02_nor_1k.jpg")
path_58 = FilePath("C:\Users\dee\Desktop\Triceratops\examples\Materials\Roof\roof_slates_02_1k_jpg\roof_slates_02_rough_1k.jpg")
texture_49 = Texture(ImagePath=path_55)
texture_50 = Texture(ImagePath=path_56)
texture_51 = Texture(ImagePath=path_57)
texture_52 = Texture(ImagePath=path_58)
meshstandardmaps_11 = MeshStandardMaterialMaps(
    Map=texture_49,
    AlphaTest=0.5,
    BumpMap=texture_50,
    BumpScale=1,
    DisplacementScale=1,
    NormalMap=texture_51,
    EnvMapIntensity=1,
    RoughnessMap=texture_52,
    AoMapIntensity=1)
mesh_24 = Mesh(<mesh referenced from the Rhino model>)
standardmat_11 = MeshStandardMaterial(
    Color=ColourSwatch(SwatchColor=RGB(112, 112, 112)),
    Opacity=1,
    Roughness=1,
    Metalness=0.5,
    Emissive=RGB(0, 0, 0),
    EmissiveIntensity=1,
    Maps=meshstandardmaps_11)
mesh_25 = Mesh(Mesh=mesh_24, Name="slate roof", Material=standardmat_11, DecimalAccuracy=3)

mesh_26 = Mesh(Mesh=mesh_13, Name="wood stove fire", Material=basicmat_2, DecimalAccuracy=3)

mesh_27 = Mesh([<mesh referenced from the Rhino model> x3])
standardmat_12 = MeshStandardMaterial(
    Color=ColourSwatch(SwatchColor=RGB(99, 148, 38)),
    Opacity=Slider(0.8, range=0..1),
    Roughness=Slider(0, range=0..1),
    Metalness=Slider(1, range=0..1),
    Emissive=RGB(0, 0, 0),
    EmissiveIntensity=1)
mesh_28 = Mesh(Mesh=mesh_27, Name="glass bottles", Material=standardmat_12, DecimalAccuracy=3)

standardmat_13 = MeshStandardMaterial(
    Color=ColourSwatch(SwatchColor=RGB(38, 34, 34)),
    Opacity=1,
    Roughness=Slider(0.5, range=0..1),
    Metalness=0.5,
    Emissive=RGB(0, 0, 0),
    EmissiveIntensity=1)
mesh_29 = Mesh([<mesh referenced from the Rhino model> x32])
mesh_30 = Mesh(Mesh=mesh_29, Name="black metal", Material=standardmat_13, DecimalAccuracy=3)

# ----
# PointLightHelper
swatch_3 = ColourSwatch(SwatchColor=RGB(255, 229, 0))
preview = CustomPreview(Geometry=[ptlight.Helper, ptlight_2.Helper], Material=swatch_3)

data_2 = Data(data)

meshstandardmaps_12 = MeshStandardMaterialMaps(AlphaTest=0.5, BumpScale=1, DisplacementScale=1, EnvMap=data_2, EnvMapIntensity=Slider(1, range=0..10), AoMapIntensity=1)
mesh_31 = Mesh([<mesh referenced from the Rhino model> x2])
standardmat_14 = MeshStandardMaterial(
    Color=ColourSwatch(SwatchColor=RGB(255, 255, 255)),
    Opacity=Slider(0.2, range=0..1),
    Roughness=Slider(0, range=0..1),
    Metalness=Slider(1, range=0..1),
    Emissive=RGB(0, 0, 0),
    EmissiveIntensity=1,
    Maps=meshstandardmaps_12)
mesh_32 = Mesh(Mesh=mesh_31, Name="glazing", Material=standardmat_14, DecimalAccuracy=3)

pointsmat = PointsMaterial(
    Color=ColourSwatch(SwatchColor=RGB(255, 255, 255)),
    Size=Slider(0.01, range=0..0.01),
    SizeAttenuation=True,
    AlphaTest=0.5)
pt_4 = Point([<point referenced from the Rhino model> x8])
points = Points(Points=pt_4, PointsMaterial=pointsmat, DecimalAccuracy=3)

data_3 = Data(data)
meshstandardmaps_13 = MeshStandardMaterialMaps(AlphaTest=0.5, BumpScale=1, DisplacementScale=1, EnvMap=data_3, EnvMapIntensity=1, AoMapIntensity=1)
mesh_33 = Mesh([<mesh referenced from the Rhino model> x2])
standardmat_15 = MeshStandardMaterial(
    Color=ColourSwatch(SwatchColor=RGB(99, 148, 38)),
    Opacity=Slider(0.5, range=0..1),
    Roughness=Slider(0, range=0..1),
    Metalness=Slider(1, range=0..1),
    Emissive=RGB(0, 0, 0),
    EmissiveIntensity=1,
    Maps=meshstandardmaps_13)
mesh_34 = Mesh(Mesh=mesh_33, Name="glass bottles", Material=standardmat_15, DecimalAccuracy=3)

# ----
# DirectionalLightHelper
swatch_4 = ColourSwatch(SwatchColor=RGB(255, 229, 0))
preview_2 = CustomPreview(Geometry=dirlight.Helper, Material=swatch_4)

mesh_35 = Mesh([<mesh referenced from the Rhino model> x19])
standardmat_16 = MeshStandardMaterial(
    Color=ColourSwatch(SwatchColor=RGB(178, 152, 104)),
    Opacity=1,
    Roughness=1,
    Metalness=0.5,
    Emissive=RGB(0, 0, 0),
    EmissiveIntensity=1)
mesh_36 = Mesh(Mesh=mesh_35, Name="window frames", Material=standardmat_16, DecimalAccuracy=3)

brep = Brep([<brep referenced from the Rhino model> x9])
standardmat_17 = MeshStandardMaterial(
    Color=ColourSwatch(SwatchColor=RGB(76, 71, 67)),
    Opacity=1,
    Roughness=1,
    Metalness=0.5,
    Emissive=RGB(0, 0, 0),
    EmissiveIntensity=1)
mesh_37 = MeshBrep(
    Brep=brep,
    Settings={GridMaxCount=0, GridMinCount=16, JaggedSeams=False, MaxEdgeLength=0, MinEdgeLength=0.0001, MinTolerance=0, Refine=True, RefineAngle=0, RelativeTolerance=0.65, SimplePlanes=True, Tolerance=0})
mesh_38 = Mesh(Mesh=mesh_37, Name="rings", Material=standardmat_17, DecimalAccuracy=3)

mesh_39 = Mesh(<mesh referenced from the Rhino model>)
standardmat_18 = MeshStandardMaterial(
    Color=ColourSwatch(SwatchColor=RGB(156, 156, 156)),
    Opacity=1,
    Roughness=1,
    Metalness=0.5,
    Emissive=RGB(0, 0, 0),
    EmissiveIntensity=1)
mesh_40 = Mesh(Mesh=mesh_39, Name="parapet", Material=standardmat_18, DecimalAccuracy=3)

mesh_41 = Mesh([<mesh referenced from the Rhino model> x15])
basicmat_3 = MeshBasicMaterial(Color=ColourSwatch(SwatchColor=RGB(0, 0, 0)))
mesh_42 = Mesh(Mesh=mesh_41, Material=basicmat_3, DecimalAccuracy=3)

merge = Merge(Data1=hemilight, Data3=dirlight.Light)
merge_2 = Merge(Data1=mesh_12, Data2=ptlight_2.Light, Data3=line, Data4=ptlight.Light, Data5=mesh_26)  # -> flatten(Result)
merge_3 = Merge(Data1=merge, Data3=merge_2)
merge_4 = Merge(Data1=mesh_36, Data2=mesh_17, Data3=mesh_40, Data4=mesh_6, Data5=mesh_19, Data6=mesh_10, Data7=mesh_4)
merge_5 = Merge(
    Data1=mesh_25,
    Data2=mesh_8,
    Data3=mesh_32,
    Data4=mesh_15,
    Data5=mesh_38,
    Data6=mesh_21,
    Data7=mesh_30,
    Data8=mesh_2,
    Data9=mesh_23,
    Data10=mesh_42,
    Data11=mesh_34,
    Data12=mesh_28,
    Data13=points)
merge_6 = Merge(Data1=merge_4, Data2=merge_5)
merge_7 = Merge(Data1=merge_6, Data2=merge_3)
data_4 = Data(data)

# ----
# Compile Scene and Export
panel = Panel("water tower home")
scene = CompileScene(Objects=flatten(merge_7), Name=panel, BackgroundColor=RGB(128, 128, 128), Background=data_4)
button = Button()
nickname_2 = RelativePath()
serialize = SerializeObject(Data=scene, Minify=Toggle(False), Run=button)
json = ExportJSON(Path="C:\Users\dee\Desktop\vue-threejs-template\public\3d", FileName="water_tower.json", Data=serialize, Write=button)
